# Grasshopper definition example.gh (Grasshopper 1.0.7)
# plug-ins: THERB-GH

# ----
# step0. デフォルトの入力値を取得
# 0-2. スケジュールに関するデータをサーバから取得
toggle = BooleanToggle(True)
# 0-1. 壁体構成のデフォルトデータをサーバから取得
toggle_2 = BooleanToggle(True)
readenvelope = ReadEnvelope(Run=toggle_2)
readschedule = ReadSchedule(Run=toggle)
item = ListItem(List=readschedule, Index=0, Wrap=True)

# ----
# (壁体構成を編集したい場合)
number_slider = Slider(12, range=0..100)
vec = Vector(Vector(-27.68890331, 14.96975533, 5))
exportt = ExportT(North_direction=vec, Start_month=Slider(1, range=0..1), End_month=number_slider)

# ----
# 1-2.計算に必要な諸条件（北の方角、計算期間）を指定
number_slider_2 = Slider(0.1, range=0..0.1)
# step1. ジオメトリ、条件入力
# 1-1. ジオメトリ情報を入力
brep = Brep([<brep referenced from the Rhino model> x3])
srf = Surface([<surface referenced from the Rhino model> x3])
srf_2 = Surface(<surface referenced from the Rhino model>)

therb = THERB(Boxes=brep, Windows=srf, Overhangs=srf_2, Envelope=readenvelope, Tolerance=number_slider_2, fontsize=20)

# ----
# step2. 壁体構成を編集する
# 2-1. 編集するFaceを選択
# 2-2. 壁体構成データを取得
# 2-3. 更新する壁体構成データを選択
decompose = Decompose(Therb=therb)  # -> Rooms, Faces, Windows, Overhangs
filterfacebyproperty = FilterFaceByProperty(Faces=decompose.Faces, Bc=1, SurfT=0, Direction=-1)  # -> TrueFace, FalseFace
readconstruction = ReadConstruction(Run=Toggle(True))
item_2 = ListItem(List=readconstruction, Index=Slider(4, range=0..15), Wrap=True)
panel = Panel(readconstruction)
updateconstruction = UpdateConstruction(Face=filterfacebyproperty.TrueFace, Construction=item_2)
merge = Merge(Data1=updateconstruction, Data2=filterfacebyproperty.FalseFace)  # -> flatten(Result)
panel_2 = Panel(item_2)
compose = Compose(Rooms=decompose.Rooms, Faces=merge, Windows=decompose.Windows, Overhangs=decompose.Overhangs)

# ----
# step3. 出力をチェック
exportw = ExportW(Construction=readconstruction)
exporta = ExportA(Therb=therb)
exportb = ExportB(Therb=therb)
exportr = ExportR(Therb=therb)

exports = ExportS(Schedule=item)

panel_3 = Panel(exportt)
panel_4 = Panel(exports)
b_datファイル書き出し = Panel(exportb)
r_datファイル書き出し = Panel(exportr)
w_datファイル書き出し = Panel(exportw)
panel_5 = Panel(exporta)

# ----
# step4. 計算開始
run_simulation = RunSimulation(
    Therb=therb,
    Constructions=readconstruction,
    Schedule=item,
    Name="tutorial2after",
    Cloud=Toggle(False),
    Run=Toggle(False))

panel_6 = Panel("C:\therb\tutorial1_rev")
panel_7 = Panel(run_simulation)

# ----
# step5. 計算結果をアップロード
# https://therb-frontend-amber.vercel.app/projects
uploadresult = UploadResult()
panel_8 = Panel(uploadresult)
